# Grasshopper definition Ettv_BcaValidationCaseStudy.gh (Grasshopper 1.0.8)
# plug-ins: FacadeFlux Info

brep = Brep([<brep referenced from the Rhino model> x2])
brep_2 = Brep([<brep referenced from the Rhino model> x2])
brep_3 = Brep([<brep referenced from the Rhino model> x2])
brep_4 = Brep([<brep referenced from the Rhino model> x2])
brep_5 = Brep([<brep referenced from the Rhino model> x2])
brep_6 = Brep([<brep referenced from the Rhino model> x21])
brep_7 = Brep([<brep referenced from the Rhino model> x21])
brep_8 = Brep([<brep referenced from the Rhino model> x21])
deconstruct_brep = DeconstructBrep(Brep=brep)  # -> Faces, Edges, Vertices
deconstruct_brep_2 = DeconstructBrep(Brep=brep_2)  # -> Faces, Edges, Vertices
deconstruct_brep_3 = DeconstructBrep(Brep=brep_3)  # -> Faces, Edges, Vertices
deconstruct_brep_4 = DeconstructBrep(Brep=brep_4)  # -> Faces, Edges, Vertices
deconstruct_brep_5 = DeconstructBrep(Brep=brep_5)  # -> Faces, Edges, Vertices
deconstruct_brep_6 = DeconstructBrep(Brep=brep_6)  # -> Faces, Edges, Vertices
deconstruct_brep_7 = DeconstructBrep(Brep=brep_7)  # -> Faces, Edges, Vertices
deconstruct_brep_8 = DeconstructBrep(Brep=brep_8)  # -> Faces, Edges, Vertices
fluxsurface = FluxSurface()
